# Dynamo graph Compare_GenericModel_Family_vs_IFC.dyn (Dynamo 2.19.3.6394)
# author: DynaRevit Dev Assistant
# So sánh shape Generic Model Family (scope = Family + Type của instance đã chọn) với file IFC chỉ định. Output Watch trả về trạng thái TRUNG_100 / CHUA_TRUNG + chi tiết mismatch / vật thể lạ.

select_model_element = DSModelElementSelection()  # nothing selected; graph input
file_path = Filename("No file selected.")  # graph input
python_script = Python(IN[0]=select_model_element, IN[1]=file_path)  # CPython3
# ---------- python_script.python (1865 lines) ----------
import clr

import os

import math

import time



clr.AddReference("RevitAPI")

clr.AddReference("RevitAPIIFC")

from Autodesk.Revit.DB import *

from Autodesk.Revit.DB.IFC import IFCImportOptions, IFCImportIntent, IFCImportAction



clr.AddReference("RevitServices")

from RevitServices.Persistence import DocumentManager



doc = DocumentManager.Instance.CurrentDBDocument

uiapp = DocumentManager.Instance.CurrentUIApplication

app = uiapp.Application



FT_TO_MM = 304.8

EPS = 1e-9

MAX_SMART_LINES = 12

HIST_BINS_RADIAL = 16

HIST_BINS_AXIS = 8





def as_string(value):

    if value is None:

        return ""

    try:

        return str(value)

    except Exception:

        return ""





def round_mm(feet_value):

    return round(float(feet_value) * FT_TO_MM, 3)





def round_pct01(score):

    return round(max(0.0, min(1.0, float(score))) * 100.0, 2)





def delta_pct(a, b):

    a = float(a or 0.0)

    b = float(b or 0.0)

    denom = max(abs(a), abs(b), EPS)

    return round(abs(a - b) / denom * 100.0, 2)





def safe_name(elem):

    try:

        name = as_string(elem.Name).strip()

        if name:

            return name

    except Exception:

        pass

    try:

        return as_string(elem.GetType().Name)

    except Exception:

        return "<unknown>"





def safe_category(elem):

    try:

        if elem.Category:

            return as_string(elem.Category.Name)

    except Exception:

        pass

    return "<no-category>"





def to_xyz_tuple(value):

    if value is None:

        return None

    try:

        x = float(value.X)

        y = float(value.Y)

        z = float(value.Z)

        return (x, y, z)

    except Exception:

        pass

    try:

        if hasattr(value, "__getitem__") and len(value) >= 3:

            return (float(value[0]), float(value[1]), float(value[2]))

    except Exception:

        pass

    return None





def clone_xyz(value):

    coords = to_xyz_tuple(value)

    if coords is None:

        return None

    return XYZ(coords[0], coords[1], coords[2])





def read_parameter_value(param):

    if param is None:

        return ""

    try:

        if not param.HasValue:

            return ""

    except Exception:

        pass

    try:

        storage = param.StorageType

        if storage == StorageType.String:

            return as_string(param.AsString()).strip()

        if storage == StorageType.Integer:

            return as_string(param.AsInteger()).strip()

        if storage == StorageType.Double:

            return as_string(param.AsDouble()).strip()

        if storage == StorageType.ElementId:

            return as_string(param.AsElementId().IntegerValue).strip()

    except Exception:

        pass

    try:

        return as_string(param.AsValueString()).strip()

    except Exception:

        return ""





def get_param_string(elem, bip=None, names=None, include_type=False):

    names = names or []

    if elem is None:

        return ""

    targets = [elem]

    if include_type:

        try:

            type_id = elem.GetTypeId()

            if type_id and type_id.IntegerValue > 0:

                targets.append(elem.Document.GetElement(type_id))

        except Exception:

            pass

    for target in targets:

        if target is None:

            continue

        if bip is not None:

            try:

                value = read_parameter_value(target.get_Parameter(bip))

                if value:

                    return value

            except Exception:

                pass

        for name in names:

            try:

                value = read_parameter_value(target.LookupParameter(name))

                if value:

                    return value

            except Exception:

                pass

    return ""





def bbox_from_points(points):

    if not points:

        return None

    coords = [to_xyz_tuple(p) for p in points]

    coords = [c for c in coords if c is not None]

    if not coords:

        return None

    min_x = min(c[0] for c in coords)

    min_y = min(c[1] for c in coords)

    min_z = min(c[2] for c in coords)

    max_x = max(c[0] for c in coords)

    max_y = max(c[1] for c in coords)

    max_z = max(c[2] for c in coords)

    bbox = BoundingBoxXYZ()

    bbox.Min = XYZ(min_x, min_y, min_z)

    bbox.Max = XYZ(max_x, max_y, max_z)

    return bbox





def bbox_center(bbox):

    return XYZ(

        (bbox.Min.X + bbox.Max.X) * 0.5,

        (bbox.Min.Y + bbox.Max.Y) * 0.5,

        (bbox.Min.Z + bbox.Max.Z) * 0.5,

    )





def bbox_sizes(bbox):

    return [

        abs(bbox.Max.X - bbox.Min.X),

        abs(bbox.Max.Y - bbox.Min.Y),

        abs(bbox.Max.Z - bbox.Min.Z),

    ]





def bbox_diag(bbox):

    dx, dy, dz = bbox_sizes(bbox)

    return math.sqrt(dx * dx + dy * dy + dz * dz)





def list_similarity(a, b):

    if not a or not b or len(a) != len(b):

        return 0.0

    scores = []

    for va, vb in zip(a, b):

        denom = max(abs(float(va)), abs(float(vb)), EPS)

        scores.append(max(0.0, 1.0 - abs(float(va) - float(vb)) / denom))

    return sum(scores) / float(len(scores))





def cosine_similarity(a, b):

    if not a or not b or len(a) != len(b):

        return 0.0

    dot = sum(float(x) * float(y) for x, y in zip(a, b))

    norm_a = math.sqrt(sum(float(x) * float(x) for x in a))

    norm_b = math.sqrt(sum(float(y) * float(y) for y in b))

    if norm_a <= EPS or norm_b <= EPS:

        return 0.0

    return max(0.0, min(1.0, dot / (norm_a * norm_b)))





def triangle_area(a, b, c):

    a_xyz = to_xyz_tuple(a)

    b_xyz = to_xyz_tuple(b)

    c_xyz = to_xyz_tuple(c)

    if a_xyz is None or b_xyz is None or c_xyz is None:

        return 0.0

    ab = XYZ(b_xyz[0] - a_xyz[0], b_xyz[1] - a_xyz[1], b_xyz[2] - a_xyz[2])

    ac = XYZ(c_xyz[0] - a_xyz[0], c_xyz[1] - a_xyz[1], c_xyz[2] - a_xyz[2])

    cross = ab.CrossProduct(ac)

    return 0.5 * cross.GetLength()





def reduce_points(points, max_points=2500):

    if len(points) <= max_points:

        return points

    step = int(math.ceil(len(points) / float(max_points)))

    return points[::step]





def collect_geometry(elem):

    solids = []

    meshes = []

    options = Options()

    options.DetailLevel = ViewDetailLevel.Fine

    options.IncludeNonVisibleObjects = False

    try:

        options.ComputeReferences = False

    except Exception:

        pass

    try:

        geom = elem.get_Geometry(options)

    except Exception:

        geom = None

    if geom is None:

        return solids, meshes

    stack = [geom]

    while stack:

        current = stack.pop()

        for obj in current:

            if obj is None:

                continue

            if isinstance(obj, Solid):

                try:

                    if obj.Volume > EPS or obj.Faces.Size > 0:

                        solids.append(obj)

                except Exception:

                    try:

                        if obj.Faces.Size > 0:

                            solids.append(obj)

                    except Exception:

                        pass

            elif isinstance(obj, Mesh):

                try:

                    if obj.NumTriangles > 0:

                        meshes.append(obj)

                except Exception:

                    pass

            elif isinstance(obj, GeometryInstance):

                try:

                    stack.append(obj.GetInstanceGeometry())

                except Exception:

                    try:

                        stack.append(obj.GetSymbolGeometry())

                    except Exception:

                        pass

    return solids, meshes





def collect_points_and_area_from_mesh(mesh):

    pts = []

    area = 0.0

    try:

        triangle_count = mesh.NumTriangles

    except Exception:

        triangle_count = 0

    for i in range(triangle_count):

        tri = mesh.get_Triangle(i)

        a = clone_xyz(tri.get_Vertex(0))

        b = clone_xyz(tri.get_Vertex(1))

        c = clone_xyz(tri.get_Vertex(2))

        if a is None or b is None or c is None:

            continue

        pts.extend([a, b, c])

        area += triangle_area(a, b, c)

    return pts, area





def collect_points_and_area_from_solids(solids):

    pts = []

    area = 0.0

    for solid in solids:

        try:

            area += float(solid.SurfaceArea)

        except Exception:

            pass

        try:

            face_count = solid.Faces.Size

        except Exception:

            face_count = 0

        if face_count == 0:

            try:

                bb = solid.GetBoundingBox()

                min_pt = clone_xyz(bb.Min)

                max_pt = clone_xyz(bb.Max)

                if min_pt is not None:

                    pts.append(min_pt)

                if max_pt is not None:

                    pts.append(max_pt)

            except Exception:

                pass

            continue

        for face in solid.Faces:

            try:

                mesh = face.Triangulate()

                mesh_pts, _ = collect_points_and_area_from_mesh(mesh)

                pts.extend(mesh_pts)

            except Exception:

                pass

    return pts, area





def union_solids(solids):

    union_solid = None

    failures = 0

    for solid in solids:

        if solid is None:

            continue

        try:

            if union_solid is None:

                union_solid = solid

            else:

                result = BooleanOperationsUtils.ExecuteBooleanOperation(

                    union_solid,

                    solid,

                    BooleanOperationsType.Union,

                )

                if result is not None:

                    union_solid = result

                else:

                    failures += 1

        except Exception:

            failures += 1

    return union_solid, failures





def build_histograms(points, bbox, center, diag):

    if not points:

        points = [

            bbox.Min,

            bbox.Max,

            XYZ(bbox.Min.X, bbox.Min.Y, bbox.Max.Z),

            XYZ(bbox.Min.X, bbox.Max.Y, bbox.Min.Z),

            XYZ(bbox.Max.X, bbox.Min.Y, bbox.Min.Z),

            XYZ(bbox.Max.X, bbox.Max.Y, bbox.Min.Z),

            XYZ(bbox.Max.X, bbox.Min.Y, bbox.Max.Z),

            XYZ(bbox.Min.X, bbox.Max.Y, bbox.Max.Z),

        ]

    points = reduce_points(points)

    radial = [0.0] * HIST_BINS_RADIAL

    axis = [0.0] * (HIST_BINS_AXIS * 3)

    sx, sy, sz = bbox_sizes(bbox)

    sx = sx if sx > EPS else 1.0

    sy = sy if sy > EPS else 1.0

    sz = sz if sz > EPS else 1.0

    diag = diag if diag > EPS else 1.0

    center_xyz = to_xyz_tuple(center)

    bbox_min = to_xyz_tuple(bbox.Min)

    if center_xyz is None or bbox_min is None:

        return radial, axis

    for pt in points:

        pt_xyz = to_xyz_tuple(pt)

        if pt_xyz is None:

            continue

        dx = pt_xyz[0] - center_xyz[0]

        dy = pt_xyz[1] - center_xyz[1]

        dz = pt_xyz[2] - center_xyz[2]

        dist = math.sqrt(dx * dx + dy * dy + dz * dz) / diag

        radial_idx = min(HIST_BINS_RADIAL - 1, int(dist * HIST_BINS_RADIAL))

        radial[radial_idx] += 1.0

        nx = min(0.999999, max(0.0, (pt_xyz[0] - bbox_min[0]) / sx))

        ny = min(0.999999, max(0.0, (pt_xyz[1] - bbox_min[1]) / sy))

        nz = min(0.999999, max(0.0, (pt_xyz[2] - bbox_min[2]) / sz))

        axis[min(HIST_BINS_AXIS - 1, int(nx * HIST_BINS_AXIS))] += 1.0

        axis[HIST_BINS_AXIS + min(HIST_BINS_AXIS - 1, int(ny * HIST_BINS_AXIS))] += 1.0

        axis[(HIST_BINS_AXIS * 2) + min(HIST_BINS_AXIS - 1, int(nz * HIST_BINS_AXIS))] += 1.0

    radial_total = sum(radial) or 1.0

    axis_total = sum(axis) or 1.0

    radial = [v / radial_total for v in radial]

    axis = [v / axis_total for v in axis]

    return radial, axis





def build_signature(elem, label):

    solids, meshes = collect_geometry(elem)

    if not solids and not meshes:

        return None

    volume = 0.0

    for solid in solids:

        try:

            volume += max(0.0, float(solid.Volume))

        except Exception:

            pass

    solid_points, solid_area = collect_points_and_area_from_solids(solids)

    mesh_points = []

    mesh_area = 0.0

    for mesh in meshes:

        pts, area = collect_points_and_area_from_mesh(mesh)

        mesh_points.extend(pts)

        mesh_area += area

    points = solid_points + mesh_points

    bbox = bbox_from_points(points)

    if bbox is None:

        try:

            bbox = elem.get_BoundingBox(None)

        except Exception:

            bbox = None

    if bbox is None:

        return None

    center = bbox_center(bbox)

    diag = bbox_diag(bbox)

    radial_hist, axis_hist = build_histograms(points, bbox, center, diag)

    union_solid, union_failures = union_solids(solids)

    return {

        "label": label,

        "bbox": bbox,

        "center": center,

        "bbox_sizes": bbox_sizes(bbox),

        "bbox_sizes_sorted": sorted(bbox_sizes(bbox)),

        "bbox_diag": diag,

        "volume": volume,

        "surface_area": solid_area + mesh_area,

        "point_count": len(points),

        "mesh_only": bool((not solids) and meshes),

        "radial_hist": radial_hist,

        "axis_hist": axis_hist,

        "solid_union": union_solid,

        "solid_union_failures": union_failures,

    }





def try_boolean_shape_compare(sig_a, sig_b):

    solid_a = sig_a.get("solid_union")

    solid_b = sig_b.get("solid_union")

    if solid_a is None or solid_b is None:

        return None, None, None, None

    try:

        move_a = Transform.CreateTranslation(XYZ(-sig_a["center"].X, -sig_a["center"].Y, -sig_a["center"].Z))

        move_b = Transform.CreateTranslation(XYZ(-sig_b["center"].X, -sig_b["center"].Y, -sig_b["center"].Z))

        norm_a = SolidUtils.CreateTransformed(solid_a, move_a)

        norm_b = SolidUtils.CreateTransformed(solid_b, move_b)

        union_solid = BooleanOperationsUtils.ExecuteBooleanOperation(norm_a, norm_b, BooleanOperationsType.Union)

        inter_solid = BooleanOperationsUtils.ExecuteBooleanOperation(norm_a, norm_b, BooleanOperationsType.Intersect)

        if union_solid is None or union_solid.Volume <= EPS:

            return None, None, None, None

        union_volume = float(union_solid.Volume)

        inter_volume = float(inter_solid.Volume) if inter_solid is not None else 0.0

        revit_only_pct = None

        ifc_only_pct = None

        try:

            diff_a = BooleanOperationsUtils.ExecuteBooleanOperation(norm_a, norm_b, BooleanOperationsType.Difference)

            revit_only_pct = round_pct01((float(diff_a.Volume) if diff_a is not None else 0.0) / union_volume)

        except Exception:

            pass

        try:

            diff_b = BooleanOperationsUtils.ExecuteBooleanOperation(norm_b, norm_a, BooleanOperationsType.Difference)

            ifc_only_pct = round_pct01((float(diff_b.Volume) if diff_b is not None else 0.0) / union_volume)

        except Exception:

            pass

        return max(0.0, min(1.0, inter_volume / union_volume)), union_volume, revit_only_pct, ifc_only_pct

    except Exception:

        return None, None, None, None





def compare_signatures(sig_a, sig_b):

    volume_score = list_similarity([sig_a["volume"]], [sig_b["volume"]]) if (sig_a["volume"] > EPS and sig_b["volume"] > EPS) else 0.5

    area_score = list_similarity([sig_a["surface_area"]], [sig_b["surface_area"]]) if (sig_a["surface_area"] > EPS and sig_b["surface_area"] > EPS) else 0.5

    bbox_score = list_similarity(sig_a["bbox_sizes_sorted"], sig_b["bbox_sizes_sorted"])

    radial_score = cosine_similarity(sig_a["radial_hist"], sig_b["radial_hist"])

    axis_score = cosine_similarity(sig_a["axis_hist"], sig_b["axis_hist"])

    base_score = (0.18 * volume_score) + (0.14 * area_score) + (0.23 * bbox_score) + (0.27 * radial_score) + (0.18 * axis_score)

    boolean_score, union_volume, revit_only_pct, ifc_only_pct = try_boolean_shape_compare(sig_a, sig_b)

    final_score = base_score if boolean_score is None else ((0.65 * base_score) + (0.35 * boolean_score))

    return {

        "score": max(0.0, min(1.0, final_score)),

        "base_score": max(0.0, min(1.0, base_score)),

        "boolean_jaccard": None if boolean_score is None else round_pct01(boolean_score),

        "union_volume": union_volume,

        "volume_delta_pct": delta_pct(sig_a["volume"], sig_b["volume"]),

        "area_delta_pct": delta_pct(sig_a["surface_area"], sig_b["surface_area"]),

        "bbox_delta_pct_max": max(delta_pct(a, b) for a, b in zip(sig_a["bbox_sizes_sorted"], sig_b["bbox_sizes_sorted"])),

        "revit_only_pct": revit_only_pct,

        "ifc_only_pct": ifc_only_pct,

        "bbox_score": round_pct01(bbox_score),

        "volume_score": round_pct01(volume_score),

        "area_score": round_pct01(area_score),

        "radial_score": round_pct01(radial_score),

        "axis_score": round_pct01(axis_score),

    }





def position_metrics(sig_a, sig_b):

    dist_ft = sig_a["center"].DistanceTo(sig_b["center"])

    max_diag = max(sig_a["bbox_diag"], sig_b["bbox_diag"], 0.1)

    score = max(0.0, min(1.0, 1.0 - (dist_ft / max_diag)))

    return dist_ft, score





def is_model_candidate(elem):

    try:

        if elem is None:

            return False

        if elem.ViewSpecific:

            return False

    except Exception:

        pass

    try:

        cat = elem.Category

        if cat is None:

            return False

        if cat.CategoryType != CategoryType.Model:

            return False

    except Exception:

        return False

    try:

        bbox = elem.get_BoundingBox(None)

        if bbox is None:

            return False

    except Exception:

        return False

    return True





def fast_bbox_row(elem):

    bbox = elem.get_BoundingBox(None)

    return {

        "element": elem,

        "element_id": elem.Id.IntegerValue,

        "unique_id": get_param_string(elem, names=["UniqueId"]) or as_string(getattr(elem, "UniqueId", "")),

        "name": safe_name(elem),

        "category": safe_category(elem),

        "ifc_guid": get_param_string(elem, bip=BuiltInParameter.IFC_GUID, names=["IfcGUID", "IFCGUID"], include_type=True),

        "bbox": bbox,

        "bbox_sizes_sorted": sorted(bbox_sizes(bbox)),

        "bbox_diag": bbox_diag(bbox),

        "center": bbox_center(bbox),

    }





def broad_bbox_match(base_sig, fast_row):

    diag_ratio = fast_row["bbox_diag"] / max(base_sig["bbox_diag"], EPS)

    if diag_ratio < 0.45 or diag_ratio > 2.20:

        return False

    bbox_score = list_similarity(base_sig["bbox_sizes_sorted"], fast_row["bbox_sizes_sorted"])

    return bbox_score >= 0.55





def make_project_row(elem, signature):

    return {

        "element": elem,

        "element_id": elem.Id.IntegerValue,

        "unique_id": as_string(getattr(elem, "UniqueId", "")),

        "name": safe_name(elem),

        "category": safe_category(elem),

        "ifc_guid": get_param_string(elem, bip=BuiltInParameter.IFC_GUID, names=["IfcGUID", "IFCGUID"], include_type=True),

        "signature": signature,

    }





def make_ifc_row(fast_row, signature):

    fast_row = dict(fast_row)

    fast_row["signature"] = signature

    fast_row["mesh_only"] = bool(signature.get("mesh_only"))

    return fast_row





def build_match_row(project_row, ifc_row, compare, method):

    pos_ft, pos_score = position_metrics(project_row["signature"], ifc_row["signature"])

    pos_mm = round_mm(pos_ft)

    perfect_pos_limit_mm = max(10.0, round_mm(max(project_row["signature"]["bbox_diag"], ifc_row["signature"]["bbox_diag"]) * 0.02))

    perfect = compare["score"] >= 0.995 and (compare["boolean_jaccard"] is None or compare["boolean_jaccard"] >= 99.0) and pos_mm <= perfect_pos_limit_mm

    reasons = []

    if compare["score"] < 0.995:

        reasons.append("shape {:.2f}%".format(round_pct01(compare["score"])))

    if pos_mm > perfect_pos_limit_mm:

        reasons.append("vị trí lệch {} mm".format(pos_mm))

    if compare["bbox_delta_pct_max"] > 0.5:

        reasons.append("bbox lệch max {}%".format(compare["bbox_delta_pct_max"]))

    if compare["revit_only_pct"] is not None and compare["revit_only_pct"] > 0.5:

        reasons.append("thiếu hình từ IFC {}%".format(compare["revit_only_pct"]))

    if compare["ifc_only_pct"] is not None and compare["ifc_only_pct"] > 0.5:

        reasons.append("IFC dư hình {}%".format(compare["ifc_only_pct"]))

    verdict = "TRUNG_100" if perfect else "CHUA_TRUNG"

    return {

        "verdict": verdict,

        "matching_method": method,

        "project_element_id": project_row["element_id"],

        "project_name": project_row["name"],

        "project_ifc_guid": project_row["ifc_guid"],

        "ifc_element_id": ifc_row["element_id"],

        "ifc_name": ifc_row["name"],

        "ifc_category": ifc_row["category"],

        "ifc_ifc_guid": ifc_row["ifc_guid"],

        "shape_percent": round_pct01(compare["score"]),

        "shape_signature_percent": round_pct01(compare["base_score"]),

        "boolean_jaccard_percent": compare["boolean_jaccard"],

        "position_delta_mm": pos_mm,

        "position_score_percent": round_pct01(pos_score),

        "volume_delta_pct": compare["volume_delta_pct"],

        "area_delta_pct": compare["area_delta_pct"],

        "bbox_delta_pct_max": compare["bbox_delta_pct_max"],

        "revit_only_pct": compare["revit_only_pct"],

        "ifc_only_pct": compare["ifc_only_pct"],

        "reason": "; ".join(reasons) if reasons else "Khớp 100% theo shape + vị trí trong tolerance.",

    }





def build_missing_row(project_row):

    return {

        "verdict": "THIEU_TRONG_IFC",

        "project_element_id": project_row["element_id"],

        "project_name": project_row["name"],

        "project_ifc_guid": project_row["ifc_guid"],

        "reason": "Không tìm thấy object IFC đủ giống shape để ghép với instance này.",

    }





def build_foreign_row(ifc_row):

    return {

        "verdict": "VAT_THE_LA_TRONG_IFC",

        "ifc_element_id": ifc_row["element_id"],

        "ifc_name": ifc_row["name"],

        "ifc_category": ifc_row["category"],

        "ifc_ifc_guid": ifc_row["ifc_guid"],

        "reason": "Có object trong IFC giống family đã chọn nhưng không match với instance nào trong project.",

    }





def top_issue_lines(match_rows, missing_rows, foreign_rows):

    lines = []

    for row in match_rows:

        if row["verdict"] != "TRUNG_100":

            lines.append("- Project #{0} -> IFC #{1}: {2}".format(row["project_element_id"], row["ifc_element_id"], row["reason"]))

    for row in missing_rows:

        lines.append("- Project #{0}: thiếu trong IFC".format(row["project_element_id"]))

    for row in foreign_rows:

        lines.append("- IFC #{0}: vật thể lạ / dư so với project".format(row["ifc_element_id"]))

    return lines[:MAX_SMART_LINES]





started = time.time()

ifc_doc = None

warnings = []

OUT = None





try:

    selected_input = UnwrapElement(IN[0]) if len(IN) > 0 else None

    if isinstance(selected_input, list):

        selected_input = selected_input[0] if selected_input else None

    if selected_input is None:

        OUT = {

            "status": "THIEU_INPUT",

            "smart_watch": ["Chưa chọn Generic Model trong project."],

            "reason": "Input 1 cần là 1 instance Generic Model trong project hiện tại.",

        }

    else:

        try:

            generic_model_cat_id = ElementId(BuiltInCategory.OST_GenericModel).IntegerValue

            selected_cat_id = selected_input.Category.Id.IntegerValue if selected_input.Category else None

        except Exception:

            selected_cat_id = None

        if selected_cat_id != generic_model_cat_id:

            OUT = {

                "status": "SAI_INPUT_1",

                "smart_watch": ["Element đã chọn không thuộc Generic Models."],

                "selected_name": safe_name(selected_input),

                "selected_category": safe_category(selected_input),

                "reason": "Graph này đang kỳ vọng chọn 1 Generic Model family instance.",

            }

        elif not isinstance(selected_input, FamilyInstance):

            OUT = {

                "status": "SAI_INPUT_1",

                "smart_watch": ["Element đã chọn là Generic Model nhưng không phải FamilyInstance."],

                "selected_name": safe_name(selected_input),

                "selected_category": safe_category(selected_input),

                "reason": "Hiện graph đang gom scope theo Family + Type nên cần chọn FamilyInstance.",

            }

        else:

            raw_ifc_path = IN[1] if len(IN) > 1 else None

            ifc_path = as_string(raw_ifc_path).strip().strip('"')

            if not ifc_path:

                OUT = {

                    "status": "THIEU_INPUT",

                    "smart_watch": ["Chưa chọn file IFC."],

                    "reason": "Input 2 cần là đường dẫn .ifc / .ifczip / .ifcxml.",

                }

            elif not os.path.exists(ifc_path):

                OUT = {

                    "status": "KHONG_TIM_THAY_FILE",

                    "smart_watch": ["Không tìm thấy file IFC đã chọn."],

                    "ifc_file": ifc_path,

                    "reason": "Kiểm tra lại File Path node.",

                }

            elif not ifc_path.lower().endswith((".ifc", ".ifczip", ".ifcxml")):

                OUT = {

                    "status": "SAI_INPUT_2",

                    "smart_watch": ["Input 2 không phải file IFC hợp lệ."],

                    "ifc_file": ifc_path,

                    "reason": "Graph hiện hỗ trợ .ifc / .ifczip / .ifcxml.",

                }

            else:

                if selected_input.Symbol is None:

                    OUT = {

                        "status": "LOI_FAMILY_SYMBOL",

                        "smart_watch": ["Element da chon khong co Family Symbol (co the bi loi)."],

                    }

                else:

                    family_name = as_string(selected_input.Symbol.Family.Name)

                    type_name = as_string(selected_input.Symbol.Name)

                    symbol_id = selected_input.Symbol.Id.IntegerValue



                    project_elements = []

                    collector = list(FilteredElementCollector(doc).OfClass(FamilyInstance).OfCategory(BuiltInCategory.OST_GenericModel).WhereElementIsNotElementType())

                    for item in collector:

                        try:

                            if item.Symbol and item.Symbol.Id.IntegerValue == symbol_id:

                                project_elements.append(item)

                        except Exception:

                            pass

                    if not project_elements:

                        project_elements = [selected_input]

                        warnings.append("Không gom được các instance cùng Type, graph fallback về đúng element đã chọn.")



                    project_rows = []

                    for idx, elem in enumerate(project_elements):

                        sig = build_signature(elem, "project_{0}".format(idx))

                        if sig is None:

                            warnings.append("Bỏ qua Project #{0} vì không đọc được geometry.".format(elem.Id.IntegerValue))

                            continue

                        project_rows.append(make_project_row(elem, sig))



                    if not project_rows:

                        OUT = {

                            "status": "KHONG_DOC_DUOC_GEOMETRY_PROJECT",

                            "smart_watch": ["Không đọc được geometry từ Generic Model đã chọn."],

                            "selected_family": family_name,

                            "selected_type": type_name,

                        }

                    else:

                        ifc_options = IFCImportOptions()

                        ifc_options.Action = IFCImportAction.Open

                        ifc_options.Intent = IFCImportIntent.Reference

                        ifc_options.ForceImport = True

                        try:

                            ifc_options.AutoJoin = False

                        except Exception:

                            pass

                        try:

                            ifc_options.AutocorrectOffAxisLines = False

                        except Exception:

                            pass



                        ifc_doc = app.OpenIFCDocument(ifc_path, ifc_options)

                        base_project = project_rows[0]

                        raw_ifc_candidates = []

                        ifc_elements = list(FilteredElementCollector(ifc_doc).WhereElementIsNotElementType())

                        for elem in ifc_elements:

                            if not is_model_candidate(elem):

                                continue

                            try:

                                fast_row = fast_bbox_row(elem)

                            except Exception:

                                continue

                            if not broad_bbox_match(base_project["signature"], fast_row):

                                continue

                            signature = build_signature(elem, "ifc_{0}".format(fast_row["element_id"]))

                            if signature is None:

                                continue

                            quick_compare = compare_signatures(base_project["signature"], signature)

                            if quick_compare["score"] < 0.78:

                                continue

                            raw_ifc_candidates.append(make_ifc_row(fast_row, signature))



                        if not raw_ifc_candidates:

                            OUT = {

                                "status": "KHONG_TIM_THAY_CANDIDATE_IFC",

                                "smart_watch": ["Không tìm thấy object IFC nào đủ giống family đã chọn."],

                                "selected_family": family_name,

                                "selected_type": type_name,

                                "ifc_file": ifc_path,

                                "stats": {

                                    "project_instances": len(project_rows),

                                    "ifc_shape_candidates": 0,

                                },

                                "warnings": warnings,

                            }

                        else:

                            ifc_by_guid = {}

                            for row in raw_ifc_candidates:

                                guid = row.get("ifc_guid") or ""

                                if guid:

                                    ifc_by_guid.setdefault(guid, []).append(row)



                            assigned_project = set()

                            assigned_ifc = set()

                            match_rows = []



                            for project_row in project_rows:

                                guid = project_row.get("ifc_guid") or ""

                                if not guid:

                                    continue

                                candidate_list = ifc_by_guid.get(guid, [])

                                if not candidate_list:

                                    continue

                                best_candidate = None

                                best_compare = None

                                best_score = -1.0

                                for candidate in candidate_list:

                                    if candidate["element_id"] in assigned_ifc:

                                        continue

                                    compare = compare_signatures(project_row["signature"], candidate["signature"])

                                    if compare["score"] > best_score:

                                        best_candidate = candidate

                                        best_compare = compare

                                        best_score = compare["score"]

                                if best_candidate is not None:

                                    assigned_project.add(project_row["element_id"])

                                    assigned_ifc.add(best_candidate["element_id"])

                                    match_rows.append(build_match_row(project_row, best_candidate, best_compare, "IfcGUID"))



                            pair_candidates = []

                            for project_row in project_rows:

                                if project_row["element_id"] in assigned_project:

                                    continue

                                for ifc_row in raw_ifc_candidates:

                                    if ifc_row["element_id"] in assigned_ifc:

                                        continue

                                    compare = compare_signatures(project_row["signature"], ifc_row["signature"])

                                    if compare["score"] < 0.78:

                                        continue

                                    pos_ft, _ = position_metrics(project_row["signature"], ifc_row["signature"])

                                    max_diag = max(project_row["signature"]["bbox_diag"], ifc_row["signature"]["bbox_diag"], 0.1)

                                    if pos_ft > max(max_diag * 4.0, 5.0):

                                        continue

                                    cost = (pos_ft / max_diag) + ((1.0 - compare["score"]) * 2.0)

                                    pair_candidates.append((cost, project_row, ifc_row, compare))



                            pair_candidates.sort(key=lambda item: item[0])

                            for _, project_row, ifc_row, compare in pair_candidates:

                                if project_row["element_id"] in assigned_project:

                                    continue

                                if ifc_row["element_id"] in assigned_ifc:

                                    continue

                                assigned_project.add(project_row["element_id"])

                                assigned_ifc.add(ifc_row["element_id"])

                                match_rows.append(build_match_row(project_row, ifc_row, compare, "Shape+Centroid"))



                            match_rows.sort(key=lambda row: row.get("project_element_id", 0))

                            missing_rows = [build_missing_row(row) for row in project_rows if row["element_id"] not in assigned_project]

                            foreign_rows = [build_foreign_row(row) for row in raw_ifc_candidates if row["element_id"] not in assigned_ifc]



                            perfect_count = len([row for row in match_rows if row["verdict"] == "TRUNG_100"])

                            partial_count = len(match_rows) - perfect_count

                            overall_status = "TRUNG_100" if (partial_count == 0 and not missing_rows and not foreign_rows and len(match_rows) == len(project_rows)) else "CHUA_TRUNG"

                            summary = "{0} | {1}/{2} instance match 100%".format(overall_status, perfect_count, len(project_rows))

                            if missing_rows:

                                summary += " | Thiếu trong IFC: {0}".format(len(missing_rows))

                            if foreign_rows:

                                summary += " | Vật thể lạ trong IFC: {0}".format(len(foreign_rows))

                            if partial_count:

                                summary += " | Match chưa trùng hoàn toàn: {0}".format(partial_count)



                            smart_watch = [

                                "KẾT LUẬN: {0}".format(overall_status),

                                "Family + Type đang so sánh: {0} | {1}".format(family_name, type_name),

                                "Project instances: {0}".format(len(project_rows)),

                                "IFC candidates cùng shape: {0}".format(len(raw_ifc_candidates)),

                                "Match 100%: {0}".format(perfect_count),

                            ]

                            if partial_count:

                                smart_watch.append("Chưa trùng hoàn toàn: {0}".format(partial_count))

                            if missing_rows:

                                smart_watch.append("Thiếu trong IFC: {0}".format(len(missing_rows)))

                            if foreign_rows:

                                smart_watch.append("Vật thể lạ / dư trong IFC: {0}".format(len(foreign_rows)))

                            smart_watch.extend(top_issue_lines(match_rows, missing_rows, foreign_rows))

                            if warnings:

                                smart_watch.append("Warnings: {0}".format(len(warnings)))



                            OUT = {

                                "status": overall_status,

                                "summary": summary,

                                "smart_watch": smart_watch,

                                "selected_scope": "Graph hiện gom tất cả instance cùng Family + Type của element đã chọn.",

                                "selected_family": family_name,

                                "selected_type": type_name,

                                "ifc_file": ifc_path,

                                "shape_check_logic": "3 tầng check shape: (1) bbox/diag filter, (2) signature từ mesh+solid (volume/area/radial/axis histogram), (3) boolean overlap nếu lấy được solid.",

                                "stats": {

                                    "project_instances": len(project_rows),

                                    "ifc_shape_candidates": len(raw_ifc_candidates),

                                    "matched_total": len(match_rows),

                                    "perfect_matches": perfect_count,

                                    "partial_matches": partial_count,

                                    "missing_in_ifc": len(missing_rows),

                                    "foreign_ifc_objects": len(foreign_rows),

                                },

                                "match_rows": match_rows,

                                "missing_rows": missing_rows,

                                "foreign_ifc_rows": foreign_rows,

                                "warnings": warnings,

                                "processing_seconds": round(time.time() - started, 3),

                            }

finally:

    if ifc_doc is not None:

        try:

            ifc_doc.Close(False)

        except Exception:

            pass
# ----------------------------------------
watch = Watch(python_script)  # graph output
